# Grasshopper definition twisted.tower.morph.gh (Grasshopper 1.0.7)

number_slider = Slider(25, range=0..100)
polygon = Polygon(Plane=PlaneXY(0, 0, 0), Radius=Slider(50, range=0..1000), Segments=6, FilletRadius=Slider(16, range=0..100))  # -> Polygon, Length

range = Range(Domain=Domain(0, 1), Steps=expr("x-1", 10))
panel = Panel(range)
graph = GraphMapper(range, x0=0, x1=1, y0=0, y1=1, container_name="Bezier", cpx=[0, 0.25, 0.75, 1], cpy=[0, 0.25, 0.75, 1])
bnd = Bounds(Numbers=graph)
dom = ConstructDomain(DomainStart=Slider(1.28, range=0..2), DomainEnd=Slider(2, range=0..2))
remap = RemapNumbers(Value=graph, Source=bnd, Target=dom)  # -> Mapped, Clipped

series = Series(Start=0, Step=Slider(14, range=0..1000), Count=number_slider)
panel_2 = Panel(series)
Z = UnitZ(Factor=series)
move = Move(Geometry=polygon.Polygon, Motion=Z)  # -> Geometry, Transform
cp = ControlPoints(Curve=move.Geometry)  # -> Points, Weights, Knots
avr = Average(Input=cp.Points)  # -> flatten(ArithmeticMean)
viewer = ParamViewer(avr)
scale_nu = ScaleNU(Geometry=move.Geometry, Plane=avr, ScaleX=remap.Mapped, ScaleY=remap.Mapped, ScaleZ=remap.Mapped)  # -> Geometry, Transform
series_2 = Series(Start=0, Step=Slider(10, range=0..10), Count=number_slider)
rad = Radians(Degrees=series_2)
rotate = Rotate(Geometry=scale_nu.Geometry, Angle=rad, Plane=avr)  # -> Geometry, Transform
loft = Loft(Curves=rotate.Geometry, Options={Adjust=False, Closed=False, LoftEnds=0, LoftSimp=0, LoftType=0, Rebuild=10, Refit=0.01})
neg = Negative(Value=Slider(9.5, range=0..14))
cap = CapHoles(Brep=loft)
offset = OffsetSurface(Surface=loft, Distance=neg, Retrim=True)

# ---- group: Surface Box
number_slider_2 = Slider(24, range=0..100)
dom_2 = ConstructDomain(DomainStart=Slider(0.53, range=0..3), DomainEnd=Slider(8, range=4..8))
divide = DivideDomain²(Domain=offset, UCount=number_slider_2, VCount=number_slider_2)
lng = ListLength(List=divide)
random = Random(Range=dom_2, Number=lng, Seed=2)
sbox = SurfaceBox(Surface=offset, Domain=divide, Height=random)

# ----
preview = CustomPreview(Geometry=offset, Material=ColourSwatch(SwatchColor=RGB(51, 46, 46)))

# ---- group: Morph
geo = Geometry(<brep referenced from the Rhino model>)
bbox = BoundingBox(Content=geo, Plane=PlaneXY(0, 0, 0))  # -> Box, Box_2
morph = BoxMorph(Geometry=geo, Reference=bbox.Box, Target=sbox)
preview_2 = CustomPreview(
    Geometry=morph,
    Material={diffuse=RGB(221, 160, 221), emission=RGB(66, 48, 66), shine=0.5, specular=RGB(255, 255, 255), transparency=0})
